# Dynamo graph color range sandbox.dyn (Dynamo 1.3.2.2480)

code_block = CodeBlock { 255; 128; 56; 0; }
byARGB = Color.ByARGB(a=code_block.out0, r=code_block.out0, g=code_block.out2, b=code_block.out3)
byARGB_2 = Color.ByARGB(a=code_block.out0, r=code_block.out2, g=code_block.out2, b=code_block.out0)
create = List.Create(byARGB, byARGB_2, byARGB_2)
code_block_2 = CodeBlock { 0; 0.5; 1; }
create_2 = List.Create(code_block_2.out0, code_block_2.out1, code_block_2.out2)
code_block_3 = CodeBlock { 0.5; }
color_range = ColorRange(create, create_2, code_block_3)
