# Dynamo graph node-sandbox.dyn (Dynamo 2.0.1.5055)

helloNode = Dougklassen.Dynamo.HelloNode.HelloNode.HelloNode()
watch = Watch(helloNode)
helloMessage = Dougklassen.Dynamo.HelloNode.HelloNode.HelloMessage()
watch_2 = Watch(helloMessage)
